# Grasshopper definition kmeans.ghx (Grasshopper 0.9.76)
# plug-ins: Python Interpreter

pt = ConstructPoint(XCoordinate=Slider(0.212, range=0..1), YCoordinate=Slider(0.32, range=0..1), ZCoordinate=0)
X = UnitX(Factor=pt)
Z = UnitZ(Factor=pt)
panel = Panel("""1
5
9""")
panel_2 = Panel("""0
2
4""")
pt_2 = Point(graft([<point referenced from the Rhino model> x3]))
random = Random(Range=Domain(0.1, 0.25), Number=25, Seed=2)
random_2 = Random(Range=Domain(0, 360), Number=25, Seed=2)
amp = Amplitude(Vector=X, Amplitude=1)
graft = GraftTree(Tree=panel_2, IncludeEmptyLists=True, IncludeNullItems=True)
rad = Radians(Degrees=random_2)
graft_2 = GraftTree(Tree=panel, IncludeEmptyLists=True, IncludeNullItems=True)
vrot = Rotate(Vector=amp, Axis=Z, Angle=rad)
jitter = Jitter(List=vrot, Jitter=1, Seed=2)  # -> Values, Indices
panel_3 = Panel("""1
5
9""")
panel_4 = Panel("""0
2
4""")
amp_2 = Amplitude(Vector=jitter.Values, Amplitude=random)
random_3 = Random(Range=Domain(0, 1), Number=25, Seed=8)
random_4 = Random(Range=Domain(0, 1), Number=25, Seed=6)
flatten = FlattenTree(Tree=pt_2, Path="{0}")
graft_3 = GraftTree(Tree=panel_4, IncludeEmptyLists=True, IncludeNullItems=True)
graft_4 = GraftTree(Tree=panel_3, IncludeEmptyLists=True, IncludeNullItems=True)
lng = ListLength(List=flatten)
X_2 = UnitX(Factor=pt_2)
Z_2 = UnitZ(Factor=pt_2)
move = Move(Geometry=pt, Motion=amp_2)  # -> Geometry, Transform
panel_5 = Panel(lng)
random_5 = Random(Range=Domain(0.1, 0.25), Number=25, Seed=graft_3)
random_6 = Random(Range=Domain(0, 360), Number=25, Seed=graft_4)
amp_3 = Amplitude(Vector=X_2, Amplitude=1)
sph = Sphere(Base=PlaneXY(0, 0, 0), Radius=0.5)
pt_3 = ConstructPoint(XCoordinate=random_4, YCoordinate=random_3, ZCoordinate=0)
rad_2 = Radians(Degrees=random_6)
series = Series(Start=0, Step=1, Count=10)
vrot_2 = Rotate(Vector=amp_3, Axis=Z_2, Angle=rad_2)
jitter_2 = Jitter(List=vrot_2, Jitter=1, Seed=4)  # -> Values, Indices
evalsrf = EvaluateSurface(Surface=reparameterize(sph), Point=pt_3)  # -> Point, Normal, Frame
amp_4 = Amplitude(Vector=jitter_2.Values, Amplitude=random_5)
item = ListItem(Index=0, Wrap=True)
move_2 = Move(Geometry=simplify(pt_2), Motion=simplify(amp_4))  # -> Geometry, Transform
pt_4 = Point(evalsrf.Point)
path = FilePath("C:\4.projects\ML\gh_data\main\kmeans.py")
file = ReadFile(File=path, PerLineParse=False)
box = DomainBox(Base=PlaneXY(0, 0, 0), X=Domain(0, 1), Y=Domain(0, 1), Z=Domain(0, 1))
pop3d = Populate3D(Region=box, Count=100, Seed=Slider(6, range=0..10))
pt_5 = Point(flatten(pop3d))
pdecon = Deconstruct(Point=pt_5)  # -> XComponent, YComponent, ZComponent
panel_6 = Panel(pdecon.ZComponent)
kmeans = PythonScript(Code=file, Feat_1=pdecon.XComponent, Feat_2=pdecon.YComponent, Feat_3=pdecon.ZComponent, C_num=Slider(3, range=0..10))  # -> Out, A, C_points, Labels, Centroids, Centr_labels, Centr
item_2 = ListItem(List=kmeans.Out, Index=0, Wrap=True)  # -> Item, Item1, Item2, Item3, Item4, Item5
panel_7 = Panel(item_2.Item3)
panel_8 = Panel(pdecon.YComponent)
panel_9 = Panel(kmeans.Out)
chars = Characters(Text=panel_7)  # -> Result, Unicode
pt_6 = ConstructPoint(XCoordinate=item_2.Item3, YCoordinate=item_2.Item4, ZCoordinate=0)
pt_7 = ConstructPoint(XCoordinate=item_2.Item, YCoordinate=item_2.Item1, ZCoordinate=0)
col = Colour([ColourSwatch(SwatchColor=RGB(94, 191, 255)), ColourSwatch(SwatchColor=RGB(255, 56, 202)), ColourSwatch(SwatchColor=RGB(56, 255, 96)), ColourSwatch(SwatchColor=RGB(255, 228, 56))])
item_3 = ListItem(List=col, Index=chars.Result, Wrap=True)
dots = DotDisplay(Point=pt_5, Colour=item_3, Size=0.03)
